# Dynamo graph 建具表取付場所入力自動化.dyn "2512058_建具表取付場所入力自動化_修正中" (Dynamo 2.19.3.6394)
# packages: Rhythm 2025.10.3

levels = Levels("1FL")  # graph input

# group: 指定の階にあるドアを取得する
# 説明<グループの説明を編集するにはここをダブル クリック>
categories = Categories("OST_Rooms")
all_elements_of_category = ElementsOfCategory(Category=categories)
ʳʰʸᵗʰᵐ_rooms_level = Rhythm.Revit.Elements.Rooms.Level(room=all_elements_of_category)
equals = List.Equals(object=ʳʰʸᵗʰᵐ_rooms_level@L1, otherObject=levels)
filterByBoolMask = List.FilterByBoolMask(list=all_elements_of_category, mask=equals)

# group: Dynamoプレイヤー 入力値
# 説明<グループの説明を編集するにはここをダブル クリック>
近接中心性のパラメーター名 = StringInput("近接中心性")
次数中心性のパラメーター名 = StringInput("次数中心性")
部屋分割線の重み = DoubleInput(1)
扉の重み_交通コスト_のパラメーター名 = StringInput("交通コスト")
建具の取付場所_変数のパラメーター名 = StringInput("取付場所_変数1")  # graph input
string = StringInput("(建具表リスト)除外")
string_2 = StringInput("入力用_取付場所")  # graph input

# group: 部屋に入力されている近接中心性と次数中心性を空にする
# 説明<グループの説明を編集するにはここをダブル クリック>
code_block = CodeBlock { 100; }
setParameterByName = Element.SetParameterByName(element=filterByBoolMask.in, parameterName=近接中心性のパラメーター名, value=code_block)
setParameterByName_2 = Element.SetParameterByName(element=filterByBoolMask.in, parameterName=次数中心性のパラメーター名, value=code_block)

# group: 部屋に入力されている近接中心性と次数中心性を空になったら次に進む
# 説明<グループの説明を編集するにはここをダブル クリック>
code_block_2 = CodeBlock(x=setParameterByName, y=setParameterByName_2) { List.Count(x)==List.Count(y); }
code_block_3 = CodeBlock { null; }
if_ = RefactoredIf(test=code_block_2, true=filterByBoolMask.in, false=code_block_3)

# group: 部屋から部屋境界線で隣り合う部屋の組み合わせを抽出する
# 結論：使用可能
python_script = Python(IN[0]=if_)  # CPython3
# ---------- python_script.python (267 lines) ----------
# Dynamo Python (CPython3) – Adjacent Room Pairs from Rooms
# RSL-only sampling + Wall-overlap exclusion (Revit 2024)

import clr, math
clr.AddReference('RevitAPI')
clr.AddReference('RevitServices')

from Autodesk.Revit.DB import *
from RevitServices.Persistence import DocumentManager

doc = DocumentManager.Instance.CurrentDBDocument
ZAXIS = XYZ.BasisZ

# ---------- 単位 ----------
def mm_to_internal(mm):
    return UnitUtils.ConvertToInternalUnits(mm, UnitTypeId.Millimeters)

# ---------- パラメータ（既定値） ----------
offset_mm      = 350.0
sample_step_mm = 100.0
overlap_pad_mm = 10.0   # 壁重なり許容（±mm）
parallel_tol_deg = 5.0 # 平行判定

if 'IN' in globals():
    if len(IN) >= 2 and IN[1] is not None:
        try: offset_mm = float(IN[1])
        except: pass
    if len(IN) >= 3 and IN[2] is not None:
        try: sample_step_mm = float(IN[2])
        except: pass

OFFSET      = mm_to_internal(offset_mm)
STEP        = mm_to_internal(sample_step_mm)
BB_PAD      = mm_to_internal(400.0)
OVERLAP_PAD = mm_to_internal(overlap_pad_mm)
COS_TOL     = math.cos(math.radians(parallel_tol_deg))

# ---------- ユーティリティ ----------
def to_db(elem):
    api = getattr(elem, 'InternalElement', None)
    if api: return api
    try:
        return UnwrapElement(elem)
    except:
        return elem

def is_room(e):
    try:
        return isinstance(e, SpatialElement) and e.Category and \
               e.Category.Id.IntegerValue == int(BuiltInCategory.OST_Rooms)
    except:
        return False

def norm_vec(v):
    if not v or v.GetLength() < 1e-12:
        return XYZ.BasisX
    return v.Normalize()

def tangent_xy(curve, param, normalized=False):
    try:
        deriv = curve.ComputeDerivatives(param, normalized)
        tvec  = norm_vec(deriv.BasisX)
    except:
        p0, p1 = curve.GetEndPoint(0), curve.GetEndPoint(1)
        tvec = norm_vec(p1.Subtract(p0))
    return tvec

def normal_xy_from_tangent(tvec):
    n = ZAXIS.CrossProduct(tvec)
    return norm_vec(n) if n.GetLength() >= 1e-12 else XYZ.BasisX

def expand_bbox_xy(bb, pad):
    if bb is None: return None
    mn, mx = bb.Min, bb.Max
    mn2 = XYZ(mn.X - pad, mn.Y - pad, mn.Z)
    mx2 = XYZ(mx.X + pad, mx.Y + pad, mx.Z)
    bb2 = BoundingBoxXYZ(); bb2.Min = mn2; bb2.Max = mx2
    return bb2

def bbox2d_contains(bb, pt):
    if bb is None: return True
    mn, mx = bb.Min, bb.Max
    x, y = pt.X, pt.Y
    return (mn.X <= x <= mx.X) and (mn.Y <= y <= mx.Y)

def candidate_rooms(pt, room_bbs):
    return [r for (r, bb) in room_bbs if bbox2d_contains(bb, pt)]

def room_at_point_prefiltered(pt, room_bbs):
    for r in candidate_rooms(pt, room_bbs):
        try:
            if r.IsPointInRoom(pt):
                return r
        except: pass
    return None

# 弧長 STEP ピッチでサンプリング
def length_uniform_samples(curve, step_len):
    pts = []
    poly = curve.Tessellate()
    if not poly or len(poly) < 2:
        try: pts.append(curve.Evaluate(0.5, True))
        except: pass
        return pts

    cum = [0.0]
    for i in range(1, len(poly)):
        seg_len = poly[i].DistanceTo(poly[i-1])
        cum.append(cum[-1] + seg_len)
    total = cum[-1]
    if total < 1e-8:
        try: pts.append(curve.Evaluate(0.5, True))
        except: pass
        return pts

    n = max(1, int(total / step_len))
    targets = [total * (k / float(n + 1)) for k in range(1, n + 1)]

    j = 1
    for d in targets:
        while j < len(cum) and cum[j] < d:
            j += 1
        if j >= len(cum): break
        d0, d1 = cum[j-1], cum[j]
        t = 0.5 if (d1 - d0) < 1e-12 else (d - d0) / (d1 - d0)
        vec = poly[j].Subtract(poly[j-1])
        p = poly[j-1].Add(vec.Multiply(t))
        pts.append(p)

    if not pts:
        try: pts.append(curve.Evaluate(0.5, True))
        except: pass
    return pts

# ---------- 壁データ ----------
def wall_half_thickness(wall):
    try:
        wt = wall.WallType
        if wt: return 0.5 * float(wt.Width)
    except: pass
    try:
        p = wall.WallType.get_Parameter(BuiltInParameter.WALL_ATTR_WIDTH_PARAM)
        if p: return 0.5 * float(p.AsDouble())
    except: pass
    return mm_to_internal(50.0)

walls = list(FilteredElementCollector(doc).OfClass(Wall).WhereElementIsNotElementType())
walls_data = []
for w in walls:
    try:
        loc = w.Location
        if isinstance(loc, LocationCurve):
            c = loc.Curve
            if c and c.Length > 1e-6:
                walls_data.append((w, c, wall_half_thickness(w)))
    except: pass

def is_overlapped_with_wall(pm, rsl_tangent, walls_data):
    for w, wc, half_t in walls_data:
        prj = wc.Project(pm)
        if not prj: 
            continue
        q = prj.XYZPoint
        dx = pm.X - q.X; dy = pm.Y - q.Y
        dist_xy = (dx*dx + dy*dy) ** 0.5
        if dist_xy > (half_t + OVERLAP_PAD):
            continue
        w_tan = tangent_xy(wc, prj.Parameter, normalized=False)
        if abs(rsl_tangent.DotProduct(w_tan)) >= COS_TOL:
            return True
    return False

# ---------- 入力の Rooms ----------
rooms_input = None
if 'IN' in globals() and len(IN) >= 1 and IN[0] is not None:
    elems_in = IN[0] if isinstance(IN[0], list) else [IN[0]]
    rooms_input = [to_db(e) for e in elems_in if e is not None]

if rooms_input and all(is_room(r) for r in rooms_input):
    rooms = rooms_input
else:
    rooms = list(
        FilteredElementCollector(doc)
        .OfCategory(BuiltInCategory.OST_Rooms)
        .WhereElementIsNotElementType()
    )

# ---------- 近傍探索用に Room の膨張BBox ----------
room_bbs = []
for r in rooms:
    try:
        bb = r.get_BoundingBox(None)
        bb = expand_bbox_xy(bb, BB_PAD) if bb else None
    except:
        bb = None
    room_bbs.append((r, bb))

# ---------- メイン（RSLのみを対象） ----------
opt = SpatialElementBoundaryOptions()
opt.SpatialElementBoundaryLocation = SpatialElementBoundaryLocation.Finish

pair_flags = {}  # key -> {"clean":bool, "dirty":bool}

def mark_pair(a, b, clean_sample):
    ida = a.Id.IntegerValue; idb = b.Id.IntegerValue
    key = (ida, idb) if ida < idb else (idb, ida)
    flags = pair_flags.get(key, {"clean": False, "dirty": False})
    if clean_sample: flags["clean"] = True
    else:            flags["dirty"] = True
    pair_flags[key] = flags

for rm in rooms:
    segloops = rm.GetBoundarySegments(opt)
    if not segloops: 
        continue

    for loop in segloops:
        for seg in loop:
            # ★ ここで RSL（部屋分割線）以外の境界は完全に除外 ★
            eid = seg.ElementId
            if not eid or eid == ElementId.InvalidElementId:
                continue
            host = doc.GetElement(eid)
            if not isinstance(host, CurveElement):
                continue
            cat = host.Category
            if not cat or cat.Id.IntegerValue != int(BuiltInCategory.OST_RoomSeparationLines):
                continue

            # RSL の実曲線で判定
            c = seg.GetCurve() if hasattr(seg, "GetCurve") else getattr(seg, "Curve", None)
            if c is None or c.Length < 1e-8:
                continue

            for pm in length_uniform_samples(c, STEP):
                prj = c.Project(pm)
                tparam = prj.Parameter if prj else 0.5
                tvec = tangent_xy(c, tparam, normalized=False)
                nvec = normal_xy_from_tangent(tvec)

                pL = pm.Add(nvec.Multiply(OFFSET))
                pR = pm.Add(nvec.Negate().Multiply(OFFSET))

                left  = room_at_point_prefiltered(pL, room_bbs)
                right = room_at_point_prefiltered(pR, room_bbs)

                # rm と向かい合う相手が見つかった場合のみ、壁重なりを評価
                if left is rm and right is not None and right.Id != rm.Id:
                    overlapped = is_overlapped_with_wall(pm, tvec, walls_data)
                    mark_pair(rm, right, clean_sample=(not overlapped))
                elif right is rm and left is not None and left.Id != rm.Id:
                    overlapped = is_overlapped_with_wall(pm, tvec, walls_data)
                    mark_pair(rm, left, clean_sample=(not overlapped))

# ---------- 出力 ----------
pairs = []
for (ida, idb), flags in pair_flags.items():
    if flags.get("clean", False):  # RSL単独で接している点が1箇所でもある
        a = doc.GetElement(ElementId(ida))
        b = doc.GetElement(ElementId(idb))
        if a and b:
            pairs.append([a, b])

if not pairs:
    pairs = [[None, None]]

OUT = pairs
# ----------------------------------------
name = Room.Name(room=python_script)

# group: 部屋分割線による部屋のペアに重みを入力する。
count = List.Count(list=python_script)
cycle = List.Cycle(list=部屋分割線の重み, amount=count)
addItemToEnd = List.AddItemToEnd(item=cycle@L1, list=python_script@L2)

# group: 指定の階にあるドアを取得する
# 説明<グループの説明を編集するにはここをダブル クリック>
categories_2 = Categories("OST_Doors")
all_elements_of_category_2 = ElementsOfCategory(Category=categories_2)
code_block_4 = CodeBlock { "レベル"; }
getParameterValueByName = Element.GetParameterValueByName(element=all_elements_of_category_2, parameterName=code_block_4)
equals_2 = List.Equals(object=getParameterValueByName@L1, otherObject=levels)

# group: ファミリ内ファミリかどうかを判定する。
# 説明<グループの説明を編集するにはここをダブル クリック>
python_script_2 = Python(IN[0]=all_elements_of_category_2)  # CPython3
# ---------- python_script_2.python (35 lines) ----------
import clr

# Revit API を読み込み
clr.AddReference("RevitAPI")
from Autodesk.Revit.DB import FamilyInstance

# Dynamo から渡ってきた入力（Revit要素のリスト）
elements = UnwrapElement(IN[0])

is_nested_list = []   # True/False（ネストかどうか）
host_list = []        # ネストされている場合のホストファミリ（なければ None）

for e in elements:
    # FamilyInstance かどうかチェック
    fi = e if isinstance(e, FamilyInstance) else None
    
    if fi is None:
        # そもそもファミリインスタンスではない場合
        is_nested_list.append(False)
        host_list.append(None)
    else:
        # SuperComponent が None → トップレベル
        # SuperComponent がある → 何かの中にネストされている
        super_comp = fi.SuperComponent
        
        if super_comp is None:
            is_nested_list.append(False)
            host_list.append(None)
        else:
            is_nested_list.append(True)
            host_list.append(super_comp)

# OUT[0] : True/False（ネストかどうか）
# OUT[1] : ホストファミリ（ネストでない場合は None）
OUT = (is_nested_list, host_list)
# ----------------------------------------
code_block_5 = CodeBlock(X=python_script_2) { X[0]; }
not_ = Not(x=code_block_5)

# group: タイトル<グループのタイトルを編集するにはここをダブル クリック>
# 説明<グループの説明を編集するにはここをダブル クリック>
and_ = And(bool0=equals_2, bool1=not_)
filterByBoolMask_2 = List.FilterByBoolMask(list=all_elements_of_category_2, mask=and_)

# group: 建具を入力してつなぐ部屋(ペアと重み)を出力する。 重複するものやnullが含まれるものは削除する。
# ・[部屋1, 部屋2, 重み1], [部屋1, 部屋2, 重み1] →[部屋1, 部屋2, 重み1]の1つだけにする。
#  ・[部屋1, 部屋2, 重み1], [部屋1, 部屋2, 重み2] →[部屋1, 部屋2, 重み1], [部屋1, 部屋2, 重み2]の2つとも残す。
python_script_3 = Python(IN[0]=filterByBoolMask_2.in, IN[1]=扉の重み_交通コスト_のパラメーター名)  # CPython3
# ---------- python_script_3.python (179 lines) ----------
# -*- coding: utf-8 -*-

import clr

# Revit / Dynamo API 参照
clr.AddReference("RevitServices")
from RevitServices.Persistence import DocumentManager

clr.AddReference("RevitAPI")
from Autodesk.Revit.DB import BuiltInParameter, StorageType

# --- Python2/3 互換ユーティリティ ---
try:
    basestring
except NameError:
    basestring = str
try:
    unicode
except NameError:
    unicode = str
try:
    long
except NameError:
    long = int

# --- 入力 ---
doors = UnwrapElement(IN[0])  # 単体 or リストどちらでも可
param_name = IN[1] if len(IN) > 1 else None  # ① 重みを取るパラメーター名（ドア側）

# --- ActiveView のフェーズを明示取得（精度向上） ---
doc = DocumentManager.Instance.CurrentDBDocument
av = doc.ActiveView
phase_param = av.get_Parameter(BuiltInParameter.VIEW_PHASE)
phase = doc.GetElement(phase_param.AsElementId()) if phase_param else None

# --- 入力を反復可能に正規化 ---
seq = doors if isinstance(doors, (list, tuple)) else [doors]

# --- From/ToRoom 取得（例外非使用・属性存在チェックで分岐） ---
def get_rooms(inst):
    """FamilyInstance から [FromRoom, ToRoom] を返す。取得不可は None。"""
    if inst is None:
        return [None, None]

    # RevitAPI のメソッドがあれば優先（フェーズを明示して精度確保）
    if hasattr(inst, "get_FromRoom") and hasattr(inst, "get_ToRoom") and phase is not None:
        fr = inst.get_FromRoom(phase)
        tr = inst.get_ToRoom(phase)
        return [fr, tr]

    # フォールバック：Dynamo 側の簡易プロパティ
    fr = inst.FromRoom if hasattr(inst, "FromRoom") else None
    tr = inst.ToRoom if hasattr(inst, "ToRoom") else None
    return [fr, tr]

# --- Room -> 安定なID（None対応） ---
def room_id(r):
    return None if r is None else r.Id.IntegerValue

# --- ドアのパラメーター値（重み）取得：インスタンス優先→タイプ ---
def get_param_value(inst, name):
    if not name or inst is None:
        return None

    p = None
    try:
        if hasattr(inst, "LookupParameter"):
            p = inst.LookupParameter(name)
    except:
        p = None

    if p is None:
        # タイプ（FamilySymbol）側も検索
        try:
            tid = inst.GetTypeId() if hasattr(inst, "GetTypeId") else None
            if tid:
                typ = doc.GetElement(tid)
                if typ and hasattr(typ, "LookupParameter"):
                    p = typ.LookupParameter(name)
        except:
            p = None

    if p is None:
        return None

    # 値をStorageTypeに応じて取得
    try:
        st = p.StorageType
        if st == StorageType.Double:
            # 数値（内部単位）。表示単位で欲しい場合は次行に切替：
            # return p.AsValueString()
            return p.AsDouble()
        elif st == StorageType.Integer:
            return p.AsInteger()
        elif st == StorageType.String:
            s = p.AsString()
            if s is None or s == "":
                s = p.AsValueString()  # フォールバック
            return s
        elif st == StorageType.ElementId:
            eid = p.AsElementId()
            try:
                return None if eid is None or eid.IntegerValue < 0 else eid.IntegerValue
            except:
                return None
        else:
            try:
                return p.AsValueString()
            except:
                return None
    except:
        try:
            return p.AsValueString()
        except:
            return None

# --- 重みの正規化キー（重複判定用） ---
def weight_key(value):
    # Noneはそのまま
    if value is None:
        return ("NONE", None)
    # 整数
    if isinstance(value, int) or isinstance(value, long):
        return ("I", int(value))
    # 浮動小数（多少の誤差を抑えてキー化）
    try:
        if isinstance(value, float):
            return ("D", round(value, 8))
    except:
        pass
    # 文字列ほか
    try:
        return ("S", unicode(value))
    except:
        return ("S", str(value))

# --- 生トリプル生成：[From, To, 重み] ---
raw = []
for d in seq:
    fr, tr = get_rooms(d)
    w = get_param_value(d, param_name)
    raw.append([fr, tr, w])

# --- 整理ルール ---
# 1) None を含む部屋は除去
# 2) 同じ部屋同士 [x, x] は除去
# 3) [A,B, w] と [B,A, w] は同一扱いで重複除去（最初の向きを残す）
# 4) ③ 重みが違えば同じ部屋ペアでも残す
unique = []
seen = set()  # key = (min(idA,idB), max(idA,idB), weight_key)

for fr, tr, w in raw:
    ida, idb = room_id(fr), room_id(tr)

    # 1) None を含む → スキップ
    if ida is None or idb is None:
        continue
    # 2) 同一室ペア → スキップ
    if ida == idb:
        continue

    # 3) 部屋の順序無視＋4) 重みもキーに含める
    wkey = weight_key(w)
    if ida <= idb:
        key = (ida, idb, wkey)
    else:
        key = (idb, ida, wkey)

    if key in seen:
        continue
    seen.add(key)

    # 向き（From/To）は最初の出現を維持
    unique.append([fr, tr, w])

# --- 出力（形状互換） ---
# ・リスト入力 → [[from, to, 重み], ...]（整理済み）
# ・単体入力   → [from, to, 重み] or []（条件を満たさない場合は空）
OUT = unique if isinstance(doors, (list, tuple)) else (unique[0] if unique else [])
# ----------------------------------------

# group: 隣接関係のリスト
python_script_4 = Python(IN[0]=addItemToEnd, IN[1]=python_script_3)  # CPython3
# ---------- python_script_4.python (54 lines) ----------
# -*- coding: utf-8 -*-
# Dynamo Python (Revit 2024 / CPython3)
# ① IN[0], IN[1] は [[部屋1, 部屋2, 実数], ...] 形式
# ② 2つを統合
# ③ 入力時と同じ形式で出力（重複は完全一致だけ排除）
# ④ 実数に None(null) または 0 を含む場合は OUT にエラー文字列を返す

def _to_hashable(x):
    """set用のキーにできないオブジェクトはreprにフォールバック"""
    try:
        hash(x)
        return x
    except TypeError:
        return repr(x)

# 入力の正規化（Noneなどが来た場合は空リスト扱い）
data_a = IN[0] if isinstance(IN[0], list) else []
data_b = IN[1] if isinstance(IN[1], list) else []

combined = list(data_a) + list(data_b)

# 重複排除（先勝ち・順序保持）
seen = set()
merged = []
for row in combined:
    # 仕様の行か確認
    if isinstance(row, (list, tuple)) and len(row) >= 3:
        r1, r2, v = row[0], row[1], row[2]
        key = (_to_hashable(r1), _to_hashable(r2), v)
        if key in seen:
            continue
        seen.add(key)
        # 出力は元の形式（list）を維持
        merged.append([r1, r2, v])
    else:
        # 想定外の形はreprベースで一応の重複排除のみ行い、そのまま通す
        key = ("__raw__", repr(row))
        if key not in seen:
            seen.add(key)
            merged.append(row)

# エラーチェック：実数が None(null) または 0 を含むか（0.0含む）
invalid_rows = []
for row in merged:
    if isinstance(row, (list, tuple)) and len(row) >= 3:
        val = row[2]
        if val is None or (isinstance(val, (int, float)) and val == 0):
            invalid_rows.append(row)

if invalid_rows:
    # ④ エラーは出力ポートに文字列で返す
    OUT = "エラー: 実数に null または 0 が含まれています。該当行: {}".format(invalid_rows)
else:
    OUT = merged
# ----------------------------------------

# group: 次数中心性の値を求める
# 説明<グループの説明を編集するにはここをダブル クリック>
python_script_5 = Python(IN[0]=python_script_4)  # CPython3
# ---------- python_script_5.python (118 lines) ----------
# -*- coding: utf-8 -*-

from collections import defaultdict
import math

# ---------- 入力 ----------
# IN[0] : [[RoomA, RoomB, weight], [RoomC, RoomD, weight], ...]
triples = IN[0] or []

# ---------- Room -> 比較用キー（ハッシュ可能） ----------
def room_key(room):
    """
    Revit/Dynamo の Room オブジェクトから安定したハッシュキーを作る。
    Id.IntegerValue があればそれを、なければ UniqueId（文字列）、最後の保険で文字列化。
    """
    if room is None:
        return None
    rid = getattr(room, "Id", None)
    if rid is not None:
        iv = getattr(rid, "IntegerValue", None)
        if isinstance(iv, int):
            return iv
    uid = getattr(room, "UniqueId", None)
    if uid is not None:
        return str(uid)
    return str(room)

def canonical_pair(a, b):
    """
    エッジ（無向）の正規化されたペア表現を返す。
    型混在での比較エラーを避けるため、比較は try/except でフォールバック。
    """
    try:
        return (a, b) if a <= b else (b, a)
    except Exception:
        sa, sb = str(a), str(b)
        return (a, b) if sa <= sb else (b, a)

# ---------- エッジ集合（重み付き・無向）を構築（自己ループ・不正重みを除去） ----------
# edge_weights: { (u,v): summed_weight }  ※(u,v) は canonical_pair
edge_weights = {}
key_to_room = {}

for item in triples:
    if not isinstance(item, (list, tuple)) or len(item) < 3:
        continue
    r1, r2, w = item[0], item[1], item[2]

    if r1 is None or r2 is None:
        continue

    # 重みを検証・正規化（非数/非有限/<=0 は無視）
    try:
        w = float(w)
    except Exception:
        continue
    if not math.isfinite(w) or w <= 0.0:
        continue

    k1, k2 = room_key(r1), room_key(r2)
    if k1 is None or k2 is None or k1 == k2:
        continue  # 自己ループやキー不明は除外

    if k1 not in key_to_room:
        key_to_room[k1] = r1
    if k2 not in key_to_room:
        key_to_room[k2] = r2

    e = canonical_pair(k1, k2)
    prev = edge_weights.get(e)
    if prev is None:
        edge_weights[e] = w
    else:
        edge_weights[e] = prev + w  # 同一ペアは重みを合算

# 早期終了（エッジなし）
if not edge_weights:
    OUT = []
else:
    # ---------- 隣接集合と strength（加重次数）を同時に構築 ----------
    neighbors = defaultdict(set)      # { node: {neighbor, ...} }
    strength  = defaultdict(float)    # { node: sum_of_weights }
    nodes_set = set()

    # 最大エッジ重み（正規化用）
    max_w = 0.0
    for (u, v), w in edge_weights.items():
        neighbors[u].add(v)
        neighbors[v].add(u)
        strength[u] += w
        strength[v] += w
        nodes_set.add(u); nodes_set.add(v)
        if w > max_w:
            max_w = w

    n = len(nodes_set)
    denom = (n - 1) * max_w if (n > 1 and max_w > 0.0) else None

    # ---------- Room オブジェクトへ戻して整形（スコア降順） ----------
    result_list = []
    if denom is None:
        # ノード1個以下 or 有効重みなし → スコアは 0
        for k in nodes_set:
            room = key_to_room.get(k, None)
            deg = len(neighbors.get(k, ()))
            result_list.append([room, 0.0, deg])
    else:
        for k in nodes_set:
            room = key_to_room.get(k, None)
            deg = len(neighbors.get(k, ()))
            s   = strength.get(k, 0.0)
            norm_score = s / denom  # 0.0〜1.0（理論上は deg/(n-1) を上限）
            result_list.append([room, norm_score, deg])

    # スコア降順で安定ソート（同点は隣接数降順→キー昇順相当で軽く安定化）
    result_list.sort(key=lambda z: (z[1], z[2]), reverse=True)

    OUT = result_list
# ----------------------------------------

# group: 部屋に次数中心性の値を入力
# 説明<グループの説明を編集するにはここをダブル クリック>
code_block_6 = CodeBlock { 0; }
getItemAtIndex = List.GetItemAtIndex(list=python_script_5@L2, index=code_block_6)
code_block_7 = CodeBlock { 2; }
getItemAtIndex_2 = List.GetItemAtIndex(list=python_script_5@L2, index=code_block_7)
setParameterByName_3 = Element.SetParameterByName(element=getItemAtIndex, parameterName=次数中心性のパラメーター名, value=getItemAtIndex_2)

# group: Dynamoプレイヤー出力用
# 説明<グループの説明を編集するにはここをダブル クリック>
code_block_8 = CodeBlock { 0; }
getItemAtIndex_3 = List.GetItemAtIndex(list=python_script_4@L2, index=code_block_8)
code_block_9 = CodeBlock { 1; }
getItemAtIndex_4 = List.GetItemAtIndex(list=python_script_4@L2, index=code_block_9)
code_block_10 = CodeBlock { 2; }
getItemAtIndex_5 = List.GetItemAtIndex(list=python_script_4@L2, index=code_block_10)
python_script_6 = Python(IN[0]=getItemAtIndex_3, IN[1]=getItemAtIndex_4, IN[2]=getItemAtIndex_5)  # CPython3
# ---------- python_script_6.python (14 lines) ----------
# Python 標準ライブラリおよび DesignScript ライブラリをロード
import sys
import clr
clr.AddReference('ProtoGeometry')
from Autodesk.DesignScript.Geometry import *


result = []
for (r1, r2, k) in zip(IN[0], IN[1], IN[2]):
    r1_name = r1.Name
    r2_name = r2.Name
    set = [r1_name, r2_name, k]
    result.append(set)
OUT = result
# ----------------------------------------
隣接関係のリスト = Watch(python_script_6)  # graph output

# group: 部屋の組合せから近接中心性を求める
# 説明<グループの説明を編集するにはここをダブル クリック>
python_script_7 = Python(IN[0]=python_script_4)  # CPython3
# ---------- python_script_7.python (170 lines) ----------
# -*- coding: utf-8 -*-

from collections import defaultdict
import heapq
import math

# ---------- 入力 ----------
# IN[0] : [[RoomA, RoomB, weight], [RoomC, RoomD, weight], ...]
pairs = IN[0] or []

# ---------- 設定 ----------
# "distance" : 実数は距離（大きいほど遠い）
# "similarity" : 実数は類似度・強さ（大きいほど近い）→距離として 1/value に変換
WEIGHT_MODE = "distance"   # ここを "similarity" に変えると 1/weight を距離として用います
WF_IMPROVED = True         # 非連結グラフ補正（Wasserman & Faust）を有効化

# ---------- Room -> 比較用キー（ハッシュ可能） ----------
def room_key(room):
    if room is None:
        return None
    rid = getattr(room, "Id", None)
    if rid is not None:
        iv = getattr(rid, "IntegerValue", None)
        if isinstance(iv, int):
            return iv
    uid = getattr(room, "UniqueId", None)
    if uid is not None:
        return str(uid)
    # 最後の保険
    return str(room)

# ---------- 入力から無向・重み付きエッジ集合を作成 ----------
# 同一ペアの重複は「最小距離」を採用。自己ループは除外。
# 内部的には frozenset({u, v}) をキーにして無向辺を表現。
edge_map = {}        # frozenset({u, v}) -> weight(距離)
key_to_room = {}     # 計算キー -> 代表Room（最初に見つけたオブジェクト）
nodes_set = set()

def _to_distance_value(val):
    # val を距離に正規化
    try:
        w = float(val)
    except Exception:
        return None
    if not math.isfinite(w):
        return None
    if WEIGHT_MODE == "distance":
        # 距離としてそのまま使用。負は無効、0は許容（ゼロ長エッジ）
        if w < 0:
            return None
        return w
    else:  # "similarity"
        # 類似度→距離に変換。0以下は無効。
        if w <= 0:
            return None
        return 1.0 / w

for p in pairs:
    # 形式チェック
    if not isinstance(p, (list, tuple)) or len(p) < 3:
        continue
    a, b, w_raw = p[0], p[1], p[2]
    if a is None or b is None:
        continue

    ka, kb = room_key(a), room_key(b)
    if ka is None or kb is None or ka == kb:
        # None や自己ループは除外
        continue

    # 代表オブジェクト（最初に見つけた方）を記録
    if ka not in key_to_room:
        key_to_room[ka] = a
    if kb not in key_to_room:
        key_to_room[kb] = b

    # 距離値に正規化
    dist_w = _to_distance_value(w_raw)
    if dist_w is None:
        continue

    # 無向エッジは frozenset で正規化し、既存があれば最小距離を採用
    ekey = frozenset((ka, kb))
    prev = edge_map.get(ekey)
    if prev is None or dist_w < prev:
        edge_map[ekey] = dist_w

    nodes_set.add(ka)
    nodes_set.add(kb)

# ---------- 隣接辞書（無向・重み付き） ----------
# adj[u] = {v: weight, ...}
adj = {k: {} for k in nodes_set}
for ekey, w in edge_map.items():
    u, v = tuple(ekey)
    # 双方向に登録
    adj[u][v] = w
    adj[v][u] = w

# ---------- 重み付き 近接中心性（Dijkstra 使用） ----------
def dijkstra_all_dist(start, adj_local):
    """start からの最短距離（重み＝距離）辞書を返す。到達不能は含めない。"""
    dist = {start: 0.0}
    pq = [(0.0, start)]
    while pq:
        d, u = heapq.heappop(pq)
        if d > dist[u]:
            continue
        for v, w in adj_local[u].items():
            nd = d + w
            dv = dist.get(v)
            if dv is None or nd < dv:
                dist[v] = nd
                heapq.heappush(pq, (nd, v))
    return dist

def closeness_centrality_weighted(adj_local, wf_improved=True):
    nodes = list(adj_local.keys())
    N = len(nodes)
    if N == 0:
        return {}

    C = {}
    if N == 1:
        # 単一ノード（エッジなし）の場合は 0
        only = nodes[0]
        C[only] = 0.0
        return C

    for s in nodes:
        # 孤立点（次数0）は 0
        if not adj_local[s]:
            C[s] = 0.0
            continue

        dist = dijkstra_all_dist(s, adj_local)
        reachable = len(dist)  # 自身を含む
        # 自身以外への距離の総和
        total = 0.0
        for n, d in dist.items():
            if n != s:
                total += d

        if reachable <= 1 or total <= 0.0:
            C[s] = 0.0
            continue

        # 基本の定義： (到達可能ノード数-1)/総距離
        score = (reachable - 1) / total

        # 非連結グラフ補正（Wasserman & Faust）
        if wf_improved and N > 1:
            score *= (reachable - 1) / (N - 1)

        C[s] = float(score)
    return C

# ---------- 計算 ----------
scores = closeness_centrality_weighted(adj, wf_improved=WF_IMPROVED)

# ---------- Room オブジェクトへ戻して見やすく整形 ----------
# [[Room, score], ...] をスコア降順で返す
result_list = []
for k, room in key_to_room.items():
    s = scores.get(k, 0.0)
    result_list.append([room, s])

result_list.sort(key=lambda z: z[1], reverse=True)

OUT = result_list
# ----------------------------------------

# group: 部屋に近接中心性の値を入力
# 説明<グループの説明を編集するにはここをダブル クリック>
code_block_11 = CodeBlock { 0; }
getItemAtIndex_6 = List.GetItemAtIndex(list=python_script_7@L2, index=code_block_11)
code_block_12 = CodeBlock { 1; }
getItemAtIndex_7 = List.GetItemAtIndex(list=python_script_7@L2, index=code_block_12)
setParameterByName_4 = Element.SetParameterByName(element=getItemAtIndex_6, parameterName=近接中心性のパラメーター名, value=getItemAtIndex_7)

# group: 内部仕上表除外の部屋の近接中心性に99の値を入力する。
# 説明<グループの説明を編集するにはここをダブル クリック>
code_block_13 = CodeBlock { "(内部仕上表)除外"; }
getParameterValueByName_2 = Element.GetParameterValueByName(element=getItemAtIndex_6, parameterName=code_block_13)
code_block_14 = CodeBlock { 1; }
allIndicesOf = List.AllIndicesOf(list=getParameterValueByName_2, item=code_block_14)
code_block_15 = CodeBlock { 99; }
count_2 = List.Count(list=allIndicesOf)
cycle_2 = List.Cycle(list=code_block_15, amount=count_2)
python_script_8 = Python(IN[0]=getItemAtIndex_7, IN[1]=allIndicesOf, IN[2]=cycle_2)  # CPython3
# ---------- python_script_8.python (16 lines) ----------
# -*- coding: utf-8 -*-

# 入力
lst = IN[0]                 # 元のリスト
indices = IN[1] or []      # 置換する index のリスト
items = IN[2] or []        # 置換後の item のリスト

# 元のリストをコピー（破壊的変更を避ける）
result = list(lst)

# index と item のペアでループ
for idx, val in zip(indices, items):
    if isinstance(idx, int) and 0 <= idx < len(result):
        result[idx] = val  # 置き換え

OUT = result
# ----------------------------------------
setParameterByName_5 = Element.SetParameterByName(element=getItemAtIndex_6, parameterName=近接中心性のパラメーター名, value=python_script_8)

code_block_16 = CodeBlock(x=setParameterByName_5) { List.Count(x)>0; }
code_block_17 = CodeBlock { null; }
if_2 = RefactoredIf(test=code_block_16, true=filterByBoolMask_2.in, false=code_block_17)

# group: 取付場所変数に0を入力。 もしくは値のある方の変数（2or3）を入力する。
# 説明<グループの説明を編集するにはここをダブル クリック>
# note: 取付場所変数:0　→　近接中心性が低い方。もしくは次数中心性が低い方
# 取付場所変数:1　→　取付場所(入力用)
# 取付場所変数:2　→　部屋から:名称
# 取付場所変数:3　→　部屋へ:名称;
python_script_9 = Python(IN[0]=if_2, IN[1]=建具の取付場所_変数のパラメーター名)  # CPython3
# ---------- python_script_9.python (111 lines) ----------
# -*- coding: utf-8 -*-
# Revit 2024 / Dynamo CPython3 用
# IN[0] : ドア要素（単体 または リスト）
# IN[1] : 整数パラメーター名（例: "取付場所_変数"）
# OUT   : 各ドアに設定した値のリスト

import clr

# Revit / Dynamo API 参照
clr.AddReference("RevitServices")
from RevitServices.Persistence import DocumentManager
from RevitServices.Transactions import TransactionManager

clr.AddReference("RevitAPI")
from Autodesk.Revit.DB import BuiltInParameter, ElementId

doc  = DocumentManager.Instance.CurrentDBDocument
view = doc.ActiveView

# ---------- フェーズ取得（ビュー優先、なければ最後のフェーズ） ----------
def get_phase_for_doors(document, active_view):
    try:
        p_phase = active_view.get_Parameter(BuiltInParameter.VIEW_PHASE)
        if p_phase:
            eid = p_phase.AsElementId()
            if eid and eid.IntegerValue != ElementId.InvalidElementId.IntegerValue:
                return document.GetElement(eid)
    except:
        pass

    try:
        phases = list(document.Phases)
        if phases:
            return phases[-1]
    except:
        pass

    return None

phase = get_phase_for_doors(doc, view)

# ---------- 入力正規化 ----------
doors_in = IN[0]
param_name = IN[1]

if not param_name:
    raise Exception("IN[1] に整数パラメーター名（例: '取付場所_変数'）を入力してください。")

if doors_in is None:
    doors = []
elif isinstance(doors_in, (list, tuple)):
    doors = list(UnwrapElement(doors_in))
else:
    doors = [UnwrapElement(doors_in)]

# ---------- FromRoom / ToRoom ----------
def get_from_room(door, ph):
    if door is None or ph is None:
        return None
    try:
        return door.get_FromRoom(ph)
    except:
        return None

def get_to_room(door, ph):
    if door is None or ph is None:
        return None
    try:
        return door.get_ToRoom(ph)
    except:
        return None

# ---------- メイン処理 ----------
values_set = []

if doors:
    TransactionManager.Instance.EnsureInTransaction(doc)

    for d in doors:
        if d is None:
            values_set.append(None)
            continue

        from_room = get_from_room(d, phase)
        to_room   = get_to_room(d, phase)

        has_from = (from_room is not None)
        has_to   = (to_room   is not None)

        # 基本値 0
        value = 0
        # 「部屋から」あり & 「部屋へ」なし → 2
        if has_from and (not has_to):
            value = 2
        # 「部屋へ」あり & 「部屋から」なし → 3
        elif has_to and (not has_from):
            value = 3

        # パラメーター書き込み
        p = d.LookupParameter(param_name)
        if p and (not p.IsReadOnly):
            try:
                p.Set(int(value))
            except:
                pass

        values_set.append(value)

    TransactionManager.Instance.TransactionTaskDone()

OUT = values_set
# ----------------------------------------
watch = Watch(python_script_9)

openai_apiキー = StringInput("")  # graph input
gitHubのRawのURL = StringInput("")  # graph input
python_script_10 = Python(IN[0]=gitHubのRawのURL)  # CPython3
# ---------- python_script_10.python (64 lines) ----------
# Dynamo Python Script（Revit 2024 / Dynamo）
import clr
clr.AddReference('System')
from System.Net import WebClient
from System.Text import Encoding, DecoderExceptionFallback, EncoderExceptionFallback

url = IN[0]
preferred = None
if len(IN) >= 2 and IN[1]:
    preferred = str(IN[1]).lower().strip()

def get_encoding(name_or_codepage):
    try:
        return Encoding.GetEncoding(name_or_codepage)
    except:
        return None

def try_decode(data, enc):
    try:
        enc_strict = Encoding.GetEncoding(enc.CodePage,
                                          EncoderExceptionFallback(),
                                          DecoderExceptionFallback())
        return enc_strict.GetString(data)
    except:
        try:
            return enc.GetString(data)
        except:
            return None

try:
    client = WebClient()
    raw = client.DownloadData(url)

    text = None
    # BOM チェック
    if len(raw) >= 3 and raw[0] == 0xEF and raw[1] == 0xBB and raw[2] == 0xBF:
        text = Encoding.UTF8.GetString(raw)                  # UTF-8 BOM
    elif len(raw) >= 2 and raw[0] == 0xFF and raw[1] == 0xFE:
        text = Encoding.Unicode.GetString(raw)               # UTF-16 LE
    elif len(raw) >= 2 and raw[0] == 0xFE and raw[1] == 0xFF:
        text = Encoding.BigEndianUnicode.GetString(raw)      # UTF-16 BE

    if text is None:
        trial_list = []
        if preferred:
            enc = get_encoding(preferred)
            if enc: trial_list.append(enc)
        for name in ["utf-8", "shift_jis", "euc-jp", "utf-16"]:
            enc = get_encoding(name)
            if enc and enc not in trial_list:
                trial_list.append(enc)
        for enc in trial_list:
            decoded = try_decode(raw, enc)
            if decoded is not None:
                text = decoded
                break

    if text is None:
        OUT = "Error: 文字コードの自動判定に失敗しました。IN[1] に 'shift_jis' や 'utf-8' などを指定してください。"
    else:
        OUT = text  # ← 全文の文字列だけを返す

except Exception as e:
    OUT = "Error: {}".format(str(e))
# ----------------------------------------

# group: ここから名前をまとめるためのプログラム
count_3 = List.Count(list=if_2)
count_4 = List.Count(list=python_script_9)
eq = count_3 == count_4

# group: 近接中心性、次数中心性、取付場所変数に初期値を入力完了までのダム
# 説明<グループの説明を編集するにはここをダブル クリック>
code_block_18 = CodeBlock { null; }
if_3 = RefactoredIf(test=eq, true=filterByBoolMask_2.in, false=code_block_18)

# group: 建具表除外のドアを除外する
# 説明<グループの説明を編集するにはここをダブル クリック>
getParameterValueByName_3 = Element.GetParameterValueByName(element=if_3, parameterName=string)
code_block_19 = CodeBlock { 1; }
equals_3 = List.Equals(object=getParameterValueByName_3@L1, otherObject=code_block_19)
not_2 = Not(x=equals_3)
filterByBoolMask_3 = List.FilterByBoolMask(list=filterByBoolMask_2.in, mask=not_2)

# group: 基本形
# 説明<グループの説明を編集するにはここをダブル クリック>
string_3 = StringInput("(建具)建具種別")
string_4 = StringInput("(建具)取付場所")
string_5 = StringInput("(建具)姿図番号")
string_6 = StringInput("防火性能")
string_7 = StringInput("(建具)遮音性能")
string_8 = StringInput("(建具)気密性能")
string_9 = StringInput("(建具)その他性能")
string_10 = StringInput("(建具)建具番号")

# group: ドア用
# 説明<グループの説明を編集するにはここをダブル クリック>
list_create = List.Create(item0=string_3, item1=string_4, item2=string_5, item3=string_6, item4=string_7, item5=string_8, item6=string_9)

# group: サイズ系
# 説明<グループの説明を編集するにはここをダブル クリック>
string_11 = StringInput("幅")
string_12 = StringInput("高さ")
string_13 = StringInput("W'")
string_14 = StringInput("H'")
string_15 = StringInput("※W'")
string_16 = StringInput("※H'")

# group: ドア用
# 説明<グループの説明を編集するにはここをダブル クリック>
list_create_2 = List.Create(item0=string_11, item1=string_12, item2=string_13, item3=string_14, item4=string_15, item5=string_16)

# group: 枠系
# 説明<グループの説明を編集するにはここをダブル クリック>
string_17 = StringInput("(建具)枠_形状")
string_18 = StringInput("(建具)枠_見込")
string_19 = StringInput("(建具)枠_材質")
string_20 = StringInput("(建具)枠_仕上")

# group: ドア用
# 説明<グループの説明を編集するにはここをダブル クリック>
list_create_3 = List.Create(item0=string_17, item1=string_18, item2=string_19, item3=string_20)

# group: 沓摺系
# 説明<グループの説明を編集するにはここをダブル クリック>
string_21 = StringInput("(建具)沓_形状")
string_22 = StringInput("(建具)沓_材質")
string_23 = StringInput("(建具)沓_仕上")
list_create_4 = List.Create(item0=string_21, item1=string_22, item2=string_23)

# group: 扉系
# 説明<グループの説明を編集するにはここをダブル クリック>
string_24 = StringInput("(建具)扉_厚さ")
string_25 = StringInput("(建具)扉_仕上")
list_create_5 = List.Create(item0=string_24, item1=string_25)

# group: ガラス系
# 説明<グループの説明を編集するにはここをダブル クリック>
string_26 = StringInput("(建具)ガラス_種類と厚さ")
string_27 = StringInput("※ガラス_W")
string_28 = StringInput("※ガラス_H")

# group: ドア用
list_create_6 = List.Create(item0=string_26, item1=string_27, item2=string_28)

# group: がらり系
# 説明<グループの説明を編集するにはここをダブル クリック>
string_29 = StringInput("(建具)ガラリ_形状")
string_30 = StringInput("(建具)ガラリ_材質")
string_31 = StringInput("(建具)ガラリ_仕上")
string_32 = StringInput("※ガラリ_W")
string_33 = StringInput("※ガラリ_H")

# group: ドア用
list_create_7 = List.Create(item0=string_29, item1=string_30, item2=string_31, item3=string_32, item4=string_33)

# group: 把手&錠
# 説明<グループの説明を編集するにはここをダブル クリック>
string_34 = StringInput("(建具)ハン錠_ハンドル把手類_外")
string_35 = StringInput("(建具)ハン錠_ハンドル把手類_内")
string_36 = StringInput("(建具)ハン錠_錠形式_外")
string_37 = StringInput("(建具)ハン錠_錠形式_内")
string_38 = StringInput("(建具)ハン錠_錠種類")

# group: ドア用
list_create_8 = List.Create(item0=string_34, item1=string_35, item2=string_36, item3=string_37, item4=string_38)

# group: その他系
# 説明<グループの説明を編集するにはここをダブル クリック>
string_39 = StringInput("(建具)電気錠")
string_40 = StringInput("(建具)建具金物の種類")
string_41 = StringInput("(建具)備考")

# group: ドア用
list_create_9 = List.Create(item0=string_39, item1=string_40, item2=string_41)

# group: ドアに使われているパラメーター
list_create_10 = List.Create(item0=list_create, item1=list_create_2, item2=list_create_3, item3=list_create_4, item4=list_create_5, item5=list_create_6, item6=list_create_7, item7=list_create_8, item8=list_create_9)

flatten = List.Flatten(list=list_create_10)

# group: 入力されたパラメーターのリストごとに分類する
# パラメーター名がないものは自動的に無視してちゃんと機能する。
python_script_11 = Python(IN[0]=filterByBoolMask_3.in, IN[1]=flatten)  # CPython3
# ---------- python_script_11.python (185 lines) ----------
# IN[0] : Revit要素（単体 or リスト） 例) Select Model Elements
# IN[1] : パラメーター名（表示名 or BuiltInParameter名） 単体でもリストでもOK
# OUT   : (grouped_elements, keys)
#         grouped_elements: 指定パラメータ値の組み合わせごとの要素リスト（ソート済み）
#         keys            : 上記グループのキー（パラメータ値タプル、ソート済み）

import clr
import System

# Revit API
clr.AddReference('RevitAPI')
from Autodesk.Revit.DB import (
    BuiltInParameter, StorageType, ElementId
)

# RevitServices
clr.AddReference('RevitServices')
from RevitServices.Persistence import DocumentManager
doc = DocumentManager.Instance.CurrentDBDocument

# ---- 入力の正規化 ----
def to_list(x):
    return x if isinstance(x, list) else [x]

# DynamoのUnwrapElementはリストにもそのまま使えるが、保険で明示処理
def unwrap_any(x):
    try:
        return UnwrapElement(x)
    except:
        return x

raw_elements = IN[0]
elements = to_list(unwrap_any(raw_elements))
param_names = IN[1]
param_names = to_list(param_names)

# ---- ユーティリティ ----

def try_get_bip(name):
    """
    文字列から BuiltInParameter を取得（存在しなければ None）
    例: "DOOR_WIDTH" -> BuiltInParameter.DOOR_WIDTH
    """
    try:
        return getattr(BuiltInParameter, name)
    except AttributeError:
        return None

def get_type_element(elem):
    """
    要素のタイプ要素を返す（タイプ要素自身の場合は None のまま）
    """
    try:
        tid = elem.GetTypeId()
        if isinstance(tid, ElementId) and tid.IntegerValue > 0:
            return doc.GetElement(tid)
    except:
        pass
    return None

def extract_value(param):
    """
    Parameter から値を安全に取り出す
    1) AsValueString（あれば）優先
    2) 型に応じて値を返す
    """
    if param is None:
        return "Param Not Found"

    # 表示用文字列（単位付き）を最優先
    try:
        s = param.AsValueString()
        if s is not None:
            return s
    except:
        # 一部の型/状況で例外になることがあるため無視
        pass

    st = param.StorageType
    if st == StorageType.String:
        sv = param.AsString()
        return sv if sv is not None else "Null"
    elif st == StorageType.Integer:
        return param.AsInteger()
    elif st == StorageType.Double:
        # 内部単位のまま（必要ならここで単位変換を追加）
        try:
            return round(param.AsDouble(), 6)
        except:
            return "Null"
    elif st == StorageType.ElementId:
        try:
            eid = param.AsElementId()
            if eid and eid.IntegerValue > 0:
                ref_el = doc.GetElement(eid)
                # 参照先があれば名前、なければ数値ID
                return getattr(ref_el, "Name", eid.IntegerValue)
            return "Null"
        except:
            return "Null"
    else:
        return "Null"

def get_parameter_by_name_or_bip(elem, name_or_bip):
    """
    取得順序：
      1) BuiltInParameter名としてインスタンスから get_Parameter
      2) BuiltInParameter名としてタイプから get_Parameter
      3) 表示名としてインスタンスから LookupParameter
      4) 表示名としてタイプから LookupParameter
    見つからなければ "Param Not Found"
    """
    if elem is None:
        return "Param Not Found"

    # まず BIP 名として試す
    bip = try_get_bip(name_or_bip)

    # 1) インスタンス + BIP
    if bip is not None:
        try:
            p = elem.get_Parameter(bip)
            if p:
                return extract_value(p)
        except:
            pass

    # タイプ要素
    typ = get_type_element(elem)

    # 2) タイプ + BIP
    if bip is not None and typ is not None:
        try:
            p = typ.get_Parameter(bip)
            if p:
                return extract_value(p)
        except:
            pass

    # 3) インスタンス + 表示名
    try:
        p = elem.LookupParameter(name_or_bip)
        if p:
            return extract_value(p)
    except:
        pass

    # 4) タイプ + 表示名
    if typ is not None:
        try:
            p = typ.LookupParameter(name_or_bip)
            if p:
                return extract_value(p)
        except:
            pass

    return "Param Not Found"

# ---- グルーピング ----
grouped_data = {}  # key(tuple(values)) -> [elements]

for e in elements:
    # 入力が Revit API 要素でない場合に備え再度安全にアンラップ
    elem = unwrap_any(e)
    values = []
    for pname in param_names:
        v = get_parameter_by_name_or_bip(elem, pname)
        values.append(v)
    key = tuple(values)
    grouped_data.setdefault(key, []).append(e)  # 元の（ラップされた）要素を返す

# ---- ソート（キーで昇順） ----
try:
    sorted_items = sorted(grouped_data.items(), key=lambda x: x[0])
except TypeError:
    # 型が混在する場合（数値と文字列など）は文字列化してソート
    sorted_items = sorted(grouped_data.items(), key=lambda x: str(x[0]))

grouped_elements = []
keys = []
for k, grp in sorted_items:
    grouped_elements.append(grp)
    keys.append(k)

OUT = grouped_elements, keys
# ----------------------------------------
code_block_20 = CodeBlock(x=python_script_11) { x[0]; }

# group: グループ内に複数個あるものを抽出する
# 説明<グループの説明を編集するにはここをダブル クリック>
count_5 = List.Count(list=code_block_20@L2)
code_block_21 = CodeBlock { 1; }
eq_2 = count_5 == code_block_21
not_3 = Not(x=eq_2)
filterByBoolMask_4 = List.FilterByBoolMask(list=code_block_20, mask=not_3)

# group: 集計表の取付場所と同じ計算結果(部屋名)を出力する。
# 集計表の計算値を取得する方法が見当たらないため。
# 計算値は共有パラでも、組み込みパラでも、プロジェクトパラでもないため。
# ※集計表の計算式を変えた場合はこの式も変えなければならない。
python_script_12 = Python(IN[0]=filterByBoolMask_4.in, IN[1]=近接中心性のパラメーター名, IN[2]=次数中心性のパラメーター名, IN[3]=建具の取付場所_変数のパラメーター名)  # CPython3
# ---------- python_script_12.python (261 lines) ----------
# -*- coding: utf-8 -*-
# Revit 2024 / Dynamo CPython3 用
# IN[0] : リスト内リスト構造のドア要素
# IN[1] : 部屋パラメーター名（近接中心性）
# IN[2] : 部屋パラメーター名（次数中心性）
# IN[3] : ドアパラメーター名（取付場所_変数1）
# OUT   : IN[0] と同じリスト構造で「取付場所（文字列）」を出力

import clr

# Dynamo / Revit API
clr.AddReference("RevitServices")
from RevitServices.Persistence import DocumentManager
from RevitServices.Transactions import TransactionManager

clr.AddReference("RevitAPI")
from Autodesk.Revit.DB import BuiltInParameter, ElementId

# ---------- 入力 ----------
doors_in          = IN[0]
param_closeness   = IN[1]  # 部屋：近接中心性
param_degree      = IN[2]  # 部屋：次数中心性
param_attach_var  = IN[3]  # ドア：取付場所_変数1（整数）

# 「入力用_取付場所」は式中で固定名として出てきているので、ここでは名前を固定します
PARAM_MANUAL_NAME = "入力用_取付場所"

doc  = DocumentManager.Instance.CurrentDBDocument
view = doc.ActiveView

# ---------- フェーズ取得（ビュー優先、なければ最後のフェーズ） ----------
def get_phase_for_doors(document, active_view):
    # 1. ビューのフェーズ
    try:
        p_phase = active_view.get_Parameter(BuiltInParameter.VIEW_PHASE)
        if p_phase:
            eid = p_phase.AsElementId()
            if eid and eid.IntegerValue != ElementId.InvalidElementId.IntegerValue:
                return document.GetElement(eid)
    except:
        pass

    # 2. プロジェクト中の最後のフェーズ
    try:
        phases = list(document.Phases)
        if phases:
            return phases[-1]
    except:
        pass

    return None

phase = get_phase_for_doors(doc, view)

# ---------- 入力の Unwrap ＋ リスト構造保持 ----------
def unwrap_recursive(obj):
    """リスト内リストの構造を保ったまま UnwrapElement する"""
    from System import Array  # .NET 配列対策
    if isinstance(obj, (list, tuple)) or isinstance(obj, Array):
        return [unwrap_recursive(o) for o in obj]
    else:
        try:
            return UnwrapElement(obj)
        except:
            return obj

doors_tree = unwrap_recursive(doors_in)

# ---------- Room / パラメーター取得系 ----------

def get_from_room(door, ph):
    """ドアの『部屋から』を返す。部屋がなければ None。"""
    if door is None or ph is None:
        return None
    try:
        return door.get_FromRoom(ph)
    except:
        return None

def get_to_room(door, ph):
    """ドアの『部屋へ』を返す。部屋がなければ None。"""
    if door is None or ph is None:
        return None
    try:
        return door.get_ToRoom(ph)
    except:
        return None

def get_room_param_double(room, param_name):
    """部屋の数値パラメーター（Double）を取得。なければ None。"""
    if room is None or not param_name:
        return None
    p = room.LookupParameter(param_name)
    if p is None:
        return None
    try:
        # 数値パラメーター想定
        return p.AsDouble()
    except:
        # もし文字列で入っている場合は、float 変換を試みる
        try:
            s = p.AsString()
            if s is None:
                return None
            return float(s)
        except:
            return None

def get_room_name(room):
    """部屋名を取得。取れなければ '-'"""
    if room is None:
        return "-"
    try:
        # Room.Name プロパティ
        name = room.Name
        if name:
            return name
    except:
        pass
    try:
        p = room.get_Parameter(BuiltInParameter.ROOM_NAME)
        if p:
            s = p.AsString()
            if s:
                return s
    except:
        pass
    return "-"

def get_door_param_int(door, param_name):
    """ドアの整数パラメーター（取付場所_変数1）を取得。なければ 0 とする。"""
    if door is None or not param_name:
        return 0
    p = door.LookupParameter(param_name)
    if p is None:
        return 0
    try:
        return int(p.AsInteger())
    except:
        # Double や String の場合も一応対応
        try:
            return int(p.AsDouble())
        except:
            try:
                s = p.AsString()
                return int(s)
            except:
                return 0

def get_door_param_string(door, param_name):
    """ドアの文字列パラメーター（入力用_取付場所）を取得。なければ '-'"""
    if door is None or not param_name:
        return "-"
    p = door.LookupParameter(param_name)
    if p is None:
        return "-"
    try:
        s = p.AsString()
        if s is None or s == "":
            return "-"
        return s
    except:
        return "-"

# 比較用の小さな許容誤差（近接中心性・次数中心性用）
EPS = 1e-9

def is_less(a, b):
    """a < b を安全に判定（None が混ざったら False）"""
    if a is None or b is None:
        return False
    return a < b - EPS

def is_equal(a, b):
    """a == b を安全に判定（None が混ざったら False）"""
    if a is None or b is None:
        return False
    return abs(a - b) <= EPS

# ---------- 1つのドアから「取付場所の名前」を決めるロジック ----------
def decide_location_name_for_door(door):
    """
    集計表の式と同じロジックで、取付場所となる部屋名などを返す。
    """

    # 取付場所_変数1（整数）
    v = get_door_param_int(door, param_attach_var)

    # From / To の部屋
    from_room = get_from_room(door, phase)
    to_room   = get_to_room(door, phase)

    # 近接中心性
    cf_from = get_room_param_double(from_room, param_closeness)
    cf_to   = get_room_param_double(to_room,   param_closeness)

    # 次数中心性
    cd_from = get_room_param_double(from_room, param_degree)
    cd_to   = get_room_param_double(to_room,   param_degree)

    # 部屋名
    name_from = get_room_name(from_room)
    name_to   = get_room_name(to_room)

    # -------------------------------
    # 集計表の if 式をそのまま Python に対応させた条件
    # -------------------------------

    # if(and(取付場所_変数1 = 0, 部屋から: 近接中心性 < 部屋へ: 近接中心性), 部屋から: 名前, ...
    if (v == 0) and is_less(cf_from, cf_to):
        return name_from

    # if(and(取付場所_変数1 = 0, 部屋から: 近接中心性 > 部屋へ: 近接中心性), 部屋へ: 名前, ...
    if (v == 0) and is_less(cf_to, cf_from):
        return name_to

    # if(and(取付場所_変数1 = 0,
    #        部屋から: 近接中心性 = 部屋へ: 近接中心性,
    #        部屋から: 次数中心性 < 部屋へ: 次数中心性), 部屋から: 名前, ...
    if (v == 0) and is_equal(cf_from, cf_to) and is_less(cd_from, cd_to):
        return name_from

    # if(and(取付場所_変数1 = 0,
    #        部屋から: 近接中心性 = 部屋へ: 近接中心性,
    #        部屋から: 次数中心性 > 部屋へ: 次数中心性), 部屋へ: 名前, ...
    if (v == 0) and is_equal(cf_from, cf_to) and is_less(cd_to, cd_from):
        return name_to

    # ★ 追加された条件 ★
    # if(and(取付場所_変数1 = 0,
    #        部屋から: 近接中心性 = 部屋へ: 近接中心性,
    #        部屋から: 次数中心性 = 部屋へ: 次数中心性), 部屋から: 名前, ...
    if (v == 0) and is_equal(cf_from, cf_to) and is_equal(cd_from, cd_to):
        return name_from

    # if(取付場所_変数1 = 1, 入力用_取付場所, ...
    if v == 1:
        return get_door_param_string(door, PARAM_MANUAL_NAME)

    # if(取付場所_変数1 = 2, 部屋から: 名前, ...
    if v == 2:
        return name_from

    # if(取付場所_変数1 = 3, 部屋へ: 名前, ...
    if v == 3:
        return name_to

    # 最後の else "-"
    return "-"

# ---------- リスト構造を保ったまま処理 ----------
def process_tree(obj):
    """doors_tree と同じ構造で、各ドアを取付場所名に変換する"""
    if isinstance(obj, list):
        return [process_tree(o) for o in obj]
    else:
        # ドア要素を想定
        return decide_location_name_for_door(obj)

# 今回は読み取りのみなのでトランザクション不要
OUT = process_tree(doors_tree)
# ----------------------------------------

# group: APIに入力するテンプレートにする
# 説明<グループの説明を編集するにはここをダブル クリック>
python_script_13 = Python(IN[0]=filterByBoolMask_4.in, IN[1]=python_script_12)  # CPython3
# ---------- python_script_13.python (25 lines) ----------
import clr
import System

# Revit APIのインポート
clr.AddReference('RevitAPI')
from Autodesk.Revit.DB import *

# IN[0]: 要素のリスト（リスト内リスト）
# IN[1]: 既に取得済みの部屋名のリスト（リスト内リスト、IN[0]と同じ構造）
elements_tree = UnwrapElement(IN[0])
names_tree    = IN[1]

list1 = []

# IN[0] と IN[1] の構造が同じである前提で、二重ループ＋zipで対応付け
for elem_row, name_row in zip(elements_tree, names_tree):
    row_result = []
    for elem, name in zip(elem_row, name_row):
        dic = {}
        dic['ID'] = elem.Id.Value
        dic['名前'] = name  # ここで LookupParameter は使わず、IN[1] の値をそのまま採用
        row_result.append(dic)
    list1.append(row_result)

OUT = list1
# ----------------------------------------

# group: 生成AIで部屋名をまとめる。
# 説明<グループの説明を編集するにはここをダブル クリック>
python_script_14 = Python(IN[0]=openai_apiキー, IN[1]=python_script_10, IN[2]=python_script_13)  # CPython3
# ---------- python_script_14.python (271 lines) ----------
# -*- coding: utf-8 -*-
"""
Revit 2024 / Dynamo (CPython3) 用
グループがいくつあっても、OpenAI API の呼び出しは 1 回だけにする版。

IN[0] : OpenAI API キー（文字列）
IN[1] : プロンプト（今回の長文ルール）
IN[2] : 部屋名称リスト
        例1: [[{'名前':..., 'ID':...}, ...], [...], ...]      ← 二重リスト
        例2: [[[{'名前':..., 'ID':...}, ...], [...], ...]]  ← 三重リスト（前回の例）

OUT  : フラットな 1 本のリスト
       [{'名前':..., 'ID':...}, {'名前':..., 'ID':...}, ...]
"""

import json
import ssl
import urllib.request
import urllib.error

# ---------- 入力 ----------
api_key = IN[0]
base_prompt = IN[1]
raw_input = IN[2]

if raw_input is None:
    raw_input = []

# ---------- OpenAI API 設定 ----------
API_URL = "https://api.openai.com/v1/chat/completions"

# Structured Outputs (response_format.json_schema) が Chat Completions で
# サポートされている gpt-4o スナップショットを利用
MODEL_NAME = "gpt-4o-2024-08-06"

_ssl_context = ssl.create_default_context()


# ---------- IN[2] から「辞書リストのグループ」だけを抜き出す ----------

def extract_groups(obj):
    """
    入れ子構造の中から
      [{'名前':..., 'ID':...}, ...]
    という「辞書のリスト」をすべて拾い出して
    [[{...}, {...}, ...], [...], ...] という 2 次元リストにして返す。
    （三重リストでも四重リストでも対応）
    """
    groups = []

    def _walk(x):
        if isinstance(x, (list, tuple)):
            if x and isinstance(x[0], dict):
                # 1 グループ発見
                groups.append(list(x))
            else:
                for y in x:
                    _walk(y)

    _walk(obj)
    return groups


groups_in = extract_groups(raw_input)
# groups_in: [[{名前,ID},...], [{名前,ID},...], ...]


# ---------- OpenAI 1 回呼び出し ----------

def call_openai_structured_all(api_key, model, prompt_text, groups):
    """
    groups: [[{名前,ID}, ...], [{名前,ID}, ...], ...] を
    まとめて 1 回の Structured Outputs で処理する。

    返り値:
        正常時 : [[{名前,ID}, ...], [{名前,ID}, ...], ...]（入力と同じ形）
        失敗時 : {"error": "...", "body": "...", "input": groups} など
    """
    # モデルに渡すための JSON テキスト
    groups_payload = {
        "groups": [
            {"items": g} for g in groups
        ]
    }

    try:
        groups_json = json.dumps(groups_payload, ensure_ascii=False)
    except Exception as e:
        return {
            "error": "groups json.dumps failed: {0}".format(e),
            "input": str(groups)
        }

    messages = [
        {
            "role": "system",
            "content": (
                "あなたは建築の部屋名称を正規化する専門アシスタントです。"
                "必ず指定された JSON Schema に従って応答し、"
                "各グループ内でのみ名前を比較して処理してください。"
                "異なるグループ間で名称をまとめたり統合しないでください。"
                "ID は入力と同じ値をそのままコピーしてください。"
            )
        },
        {
            "role": "user",
            "content": u"{prompt}\n\n対象のグループ構造:\n{data}".format(
                prompt=prompt_text,
                data=groups_json
            )
        }
    ]

    # ルート: type: "object"
    # 中に groups: array[ { items: array[ {名前,ID} ] } ]
    response_format = {
        "type": "json_schema",
        "json_schema": {
            "name": "room_name_all_groups",
            "strict": True,
            "schema": {
                "type": "object",
                "properties": {
                    "groups": {
                        "type": "array",
                        "items": {
                            "type": "object",
                            "properties": {
                                "items": {
                                    "type": "array",
                                    "items": {
                                        "type": "object",
                                        "properties": {
                                            "名前": {"type": "string"},
                                            "ID": {"type": "integer"}
                                        },
                                        "required": ["名前", "ID"],
                                        "additionalProperties": False
                                    }
                                }
                            },
                            "required": ["items"],
                            "additionalProperties": False
                        }
                    }
                },
                "required": ["groups"],
                "additionalProperties": False
            }
        }
    }

    payload = {
        "model": model,
        "messages": messages,
        "response_format": response_format
    }

    data_bytes = json.dumps(payload, ensure_ascii=False).encode("utf-8")

    headers = {
        "Content-Type": "application/json",
        "Authorization": "Bearer " + str(api_key).strip()
    }

    req = urllib.request.Request(API_URL, data=data_bytes, headers=headers)

    # ---- HTTP 呼び出し ＋ エラーハンドリング ----
    try:
        with urllib.request.urlopen(req, context=_ssl_context) as resp:
            resp_text = resp.read().decode("utf-8")
    except urllib.error.HTTPError as e:
        try:
            err_body = e.read().decode("utf-8")
        except Exception:
            err_body = ""
        return {
            "error": "HTTP error: {0} {1}".format(e.code, e.reason),
            "body": err_body,
            "input": groups
        }
    except Exception as e:
        return {
            "error": "Connection error: {0}".format(e),
            "input": groups
        }

    # ---- レスポンス JSON パース ----
    try:
        resp_json = json.loads(resp_text)
    except Exception as e:
        return {
            "error": "JSON decode error in API response: {0}".format(e),
            "raw_response": resp_text,
            "input": groups
        }

    try:
        content = resp_json["choices"][0]["message"]["content"]
    except Exception as e:
        return {
            "error": "Unexpected API response format: {0}".format(e),
            "response_json": resp_json,
            "input": groups
        }

    # message.content には JSON 文字列が入っている想定
    try:
        body = json.loads(content)
    except Exception as e:
        return {
            "error": "JSON decode error in message.content: {0}".format(e),
            "content": content,
            "input": groups
        }

    # 期待形: {"groups": [ {"items":[{名前,ID},...]}, {"items":[...]}, ... ] }
    if not (isinstance(body, dict) and "groups" in body):
        return {
            "error": "JSON schema mismatch: 'groups' not found in response.",
            "body": body,
            "input": groups
        }

    groups_out = body["groups"]

    # groups_out[i]["items"] が実際の [{名前,ID}, ...]
    results = []
    for g in groups_out:
        if isinstance(g, dict) and "items" in g:
            results.append(g["items"])
        else:
            results.append({
                "error": "group item missing 'items' field",
                "group": g
            })

    return results


# ---------- フラット化 ----------

def flatten_groups(groups_2d):
    """
    [[{...}, {...}], [{...}], ...] を
    1 本の [{...}, {...}, ...] に変換。
    （エラー情報の dict もそのまま要素として残す）
    """
    flat = []
    for g in groups_2d:
        if isinstance(g, (list, tuple)):
            for x in g:
                flat.append(x)
        else:
            flat.append(g)
    return flat


# ---------- メイン処理 ----------
if not groups_in:
    # IN[2] に辞書リストが見つからなかった場合
    OUT = []
else:
    result_groups = call_openai_structured_all(api_key, MODEL_NAME, base_prompt, groups_in)

    if isinstance(result_groups, dict) and "error" in result_groups:
        # まとめて失敗した場合は、そのまま OUT に
        OUT = [result_groups]
    else:
        # 成功した場合は 2 次元 → 1 次元にフラット化して OUT
        OUT = flatten_groups(result_groups)
# ----------------------------------------
watch_2 = Watch(python_script_14)

# group: 生成された結果を分解する。
code_block_22 = CodeBlock { "ID"; }
valueAtKey = DesignScript.Builtin.Dictionary.ValueAtKey(dictionary=watch_2, key=code_block_22)
element_by_id = ElementById(Id=valueAtKey)
code_block_23 = CodeBlock { "名前"; }
valueAtKey_2 = DesignScript.Builtin.Dictionary.ValueAtKey(dictionary=watch_2, key=code_block_23)

# group: 生成後と生成前の名前が変わらないものを除外する。 > 集計表の取付場所と同じ計算結果(部屋名)を出力する。
# 説明<グループの説明を編集するにはここをダブル クリック>
python_script_15 = Python(IN[0]=element_by_id, IN[1]=近接中心性のパラメーター名, IN[2]=次数中心性のパラメーター名, IN[3]=建具の取付場所_変数のパラメーター名)  # CPython3; same code as python_script_12

# group: 生成後と生成前の名前が変わらないものを除外する。
# 説明<グループの説明を編集するにはここをダブル クリック>
equals_4 = List.Equals()  # unwired: object, otherObject
combine = List.Combine(combineFunction=equals_4, list0=python_script_15, list1=valueAtKey_2)
not_4 = Not(x=combine)
function_node = List.FilterByBoolMask(list=element_by_id, mask=not_4)
除外された名前 = List.FilterByBoolMask(list=valueAtKey_2, mask=not_4)

# group: 生成結果が違うものに対して 取付場所をまとまった名前を入力して、取付場所変数に1を入力する。
setParameterByName_6 = Element.SetParameterByName(element=function_node.in, parameterName=string_2, value=除外された名前.in)
code_block_24 = CodeBlock { 1; }
setParameterByName_7 = Element.SetParameterByName(element=function_node.in, parameterName=建具の取付場所_変数のパラメーター名, value=code_block_24)

# group: 生成AIへのプロンプト
# 説明<グループの説明を編集するにはここをダブル クリック>
プロンプト = StringInput("""1:
From the following list of dictionaries, analyze each value of "名前", split it into a "base name" and a "variation part", then aggregate the variation parts and attach them to the base name.

1.1:
The input format in Python is:
[{'名前': <name value>, 'ID': <ID value>}, {'名前': <name value>, 'ID': <ID value>}, ...].

1.2:
Compare the values of the '名前' key across all dictionaries in the list and modify the names according to the rules below.

1.3:
The aggregation method must follow the rules in section 2.

2:
Output format:

2.1
You must output in accordance with the given JSON Schema.

2.2
The number of dictionaries in the output must be the same as the number of dictionaries in the input.

2.3
If the variation part is a number (or a string consisting only of digits), convert it to a numeric value for comparison, sort in ascending order, then convert it back to a string for output.

3:
The input room names may sometimes have no regular pattern such as serial numbering. Learn from the rules and examples below when “you are allowed to aggregate” and when “you must not aggregate”, and apply the same logic to similar patterns.

3.1:
Cases where names are aggregated:

3.1.1:
The decomposition of a name must follow one of the following three patterns. First, try the “front-base type” pattern in 3.1.2. If it does not match, try the “back-base type”. If that also fails, try the “center-base type”.

Example 3.1.1-1:
Front-base type: "Base name + Variation part"

Example 3.1.1-2:
Back-base type: "Variation part + Base name"

Example 3.1.1-3:
Center-base type: "Variation part + Base name + Variation part"

3.1.2:
Examples of patterns that are allowed as a “variation part”:

Example 3.1.2-1:
Room numbers or similar:
- Half-width or full-width digits only  
  e.g.: '101', '２', '10'
- A hyphen '-' followed only by digits or digit groups  
  e.g.: '-1', '-2-3', '-10-2'
- An underscore '_' followed only by digits  
  e.g.: '_1', '_2', '_10'

Example 3.1.2-2:
Alphabetic characters with symbols:
- A hyphen '-' followed only by alphabetic characters  
  e.g.: '-A', '-B', '-C'

Example 3.1.2-3:
Short alphabetic / Kanji / Kana:
- A single character used as the variation  
  e.g.: '北', '南', 'A', 'B'

Example 3.1.2-4:
Letters + hyphen + digits only  
  e.g.: 'B-53', 'C-7'

3.1.3:
If multiple names share the same base name and you can determine that there are at least two distinct variation parts, aggregate them by that base name. The representative name (base name) is the string obtained by removing the variation parts.  
(*These are only example patterns; actual input names may differ.*)

Example 3.1.3-1:
Input:
[{'名前':'教室101', 'ID':48291736},
 {'名前':'教室102', 'ID':65031829},
 {'名前':'教室103', 'ID':91274358}]

Base name: '教室'

Output:
[{'名前':'教室 101, 102, 103', 'ID':48291736},
 {'名前':'教室 101, 102, 103', 'ID':65031829},
 {'名前':'教室 101, 102, 103', 'ID':91274358}]

Example 3.1.3-2:
Input:
[{'名前':'Office-1',  'ID':73486021},
 {'名前':'Office-２', 'ID':58124693},
 {'名前':'Office-10', 'ID':36915842},
 {'名前':'Office-06', 'ID':20487519}]

Base name: 'Office'

Output:
[{'名前':'Office -1, 2, 10, 06', 'ID':73486021},
 {'名前':'Office -1, 2, 10, 06', 'ID':58124693},
 {'名前':'Office -1, 2, 10, 06', 'ID':36915842},
 {'名前':'Office -1, 2, 10, 06', 'ID':20487519}]

Example 3.1.3-3:
Input:
[{'名前':'保管室西', 'ID':85730264},
 {'名前':'保管室東', 'ID':49372086}]

Base name: '保管室'

Output:
[{'名前':'保管室 西, 東', 'ID':85730264},
 {'名前':'保管室 西, 東', 'ID':49372086}]

Example 3.1.3-4:
Input:
[{'名前':'ブースA',    'ID':76059413},
 {'名前':'ブースB-53', 'ID':12967384},
 {'名前':'ブースB',    'ID':84625197},
 {'名前':'ブースC-7',  'ID':30794652}]

Base name: 'ブース'

Output:
[{'名前':'ブース A, B, B-53, C-7', 'ID':76059413},
 {'名前':'ブース A, B, B-53, C-7', 'ID':12967384},
 {'名前':'ブース A, B, B-53, C-7', 'ID':84625197},
 {'名前':'ブース A, B, B-53, C-7', 'ID':30794652}]

Example 3.1.3-5:
Input:
[{'名前':'北テラス', 'ID':91580247},
 {'名前':'東テラス', 'ID':56843920}]

Base name: 'テラス'

Output:
[{'名前':'北, 東 テラス', 'ID':91580247},
 {'名前':'北, 東 テラス', 'ID':56843920}]

Example 3.1.3-6:
Input:
[{'名前':'北ギャラリー',     'ID':27360485},
 {'名前':'北東ギャラリー',   'ID':49218675},
 {'名前':'南ギャラリー3',    'ID':63057941},
 {'名前':'南ギャラリー01',   'ID':75802146}]

Base name: 'ギャラリー'

Output:
[{'名前':'北, 北東, 南_3, 南_01 ギャラリー', 'ID':27360485},
 {'名前':'北, 北東, 南_3, 南_01 ギャラリー', 'ID':49218675},
 {'名前':'北, 北東, 南_3, 南_01 ギャラリー', 'ID':63057941},
 {'名前':'北, 北東, 南_3, 南_01 ギャラリー', 'ID':75802146}]

3.2:
If only one name can be judged as belonging to a given base name, do not aggregate it by base name. Instead, treat the original full name as its own key.

Example 3.2-1:
Input:
[{'名前':'ギャラリー1', 'ID':73958124},
 {'名前':'PS',          'ID':48206379},
 {'名前':'風除室1',     'ID':95172840}]

Base name: none

Output:
[{'名前':'ギャラリー1', 'ID':73958124},
 {'名前':'PS',          'ID':48206379},
 {'名前':'風除室1',     'ID':95172840}]

3.3:
If the base names are not completely identical, do not aggregate even if they share common words.

Example 3.3-1:
Input:
[{'名前':'イベントスペースA', 'ID':30649281},
 {'名前':'展示スペースB',     'ID':87495230}]

Base name: none

Output:
[{'名前':'イベントスペースA', 'ID':30649281},
 {'名前':'展示スペースB',     'ID':87495230}]
""")  # frozen

# group: 建具パラメーター 控え用
# 説明<グループの説明を編集するにはここをダブル クリック>
string_42 = StringInput("(建具)建具種別")
string_43 = StringInput("(建具)建具番号")  # frozen
string_44 = StringInput("(建具)取付場所")
string_45 = StringInput("(建具)姿図番号")
string_46 = StringInput("防火性能")
string_47 = StringInput("(建具)遮音性能")
string_48 = StringInput("(建具)気密性能")
string_49 = StringInput("(建具)その他性能")
list_create_11 = List.Create(item0=string_42, item1=string_43, item2=string_44, item3=string_45, item4=string_46, item5=string_47, item6=string_48, item7=string_49)
string_50 = StringInput("幅")
string_51 = StringInput("高さ")
string_52 = StringInput("W'")
string_53 = StringInput("H'")
string_54 = StringInput("※W'")
string_55 = StringInput("※H'")
list_create_12 = List.Create(item0=string_50, item1=string_51, item2=string_52, item3=string_53, item4=string_54, item5=string_55)
string_56 = StringInput("(建具)枠_形状")
string_57 = StringInput("(建具)枠_見込")
string_58 = StringInput("(建具)枠_材質")
string_59 = StringInput("(建具)枠_仕上")
list_create_13 = List.Create(item0=string_56, item1=string_57, item2=string_58, item3=string_59)
string_60 = StringInput("(建具)セキュリティ")
string_61 = StringInput("構成タイプ")
string_62 = StringInput("枠タイプ(文字)")
list_create_14 = List.Create(item0=string_60, item1=string_61, item2=string_62)
string_63 = StringInput("(建具)沓_形状")
string_64 = StringInput("(建具)沓_材質")
string_65 = StringInput("(建具)沓_仕上")
list_create_15 = List.Create(item0=string_63, item1=string_64, item2=string_65)
string_66 = StringInput("(建具)取り付けレベル")
string_67 = StringInput("(建具)取付場所")
list_create_16 = List.Create(item0=string_66, item1=string_67)
string_68 = StringInput("ファミリとタイプ")
list_create_17 = List.Create(item0=string_68, item1=string_42, item2=string_43, item3=string_44)  # frozen
string_69 = StringInput("(建具)ガラリ_形状")
string_70 = StringInput("(建具)ガラリ_材質")
string_71 = StringInput("(建具)ガラリ_仕上")
string_72 = StringInput("ガラリ_W")
string_73 = StringInput("ガラリ_H")
string_74 = StringInput("※ガラリ_W")
string_75 = StringInput("※ガラリ_H")
list_create_18 = List.Create(item0=string_69, item1=string_70, item2=string_71, item3=string_72, item4=string_73, item5=string_74, item6=string_75)
string_76 = StringInput("(建具)扉_厚さ")
string_77 = StringInput("(建具)扉_仕上")
list_create_19 = List.Create(item0=string_76, item1=string_77)
string_78 = StringInput("(建具)ガラス_種類")
string_79 = StringInput("(建具)ガラス_厚さ")
string_80 = StringInput("ガラス_W")
string_81 = StringInput("ガラス_H")
string_82 = StringInput("※ガラス_W")
string_83 = StringInput("※ガラス_H")
string_84 = StringInput("(建具)ガラス_フィルム性能")
list_create_20 = List.Create(item0=string_78, item1=string_79, item2=string_80, item3=string_81, item4=string_82, item5=string_83, item6=string_84)
string_85 = StringInput("(建具)支持金物の種類")
string_86 = StringInput("(建具)ドアクローザーの種類")
string_87 = StringInput("建具符号")
string_88 = StringInput("(建具)備考")
list_create_21 = List.Create(item0=string_85, item1=string_86, item2=string_87, item3=string_88)
string_89 = StringInput("(建具)ハン錠_ハンドル把手類_外")
string_90 = StringInput("(建具)ハン錠_ハンドル把手類_内")
string_91 = StringInput("(建具)ハン錠_錠形式_外")
string_92 = StringInput("(建具)ハン錠_錠形式_内")
string_93 = StringInput("(建具)ハン錠_錠種類")
list_create_22 = List.Create(item0=string_89, item1=string_90, item2=string_91, item3=string_92, item4=string_93)
string_94 = StringInput("(建具)雑_丁番")
string_95 = StringInput("(建具)雑_オートヒンジ防火戸用")
string_96 = StringInput("(建具)雑_ピポットヒンジ")
string_97 = StringInput("(建具)雑_ドアクローザー隠蔽型")
string_98 = StringInput("(建具)雑_ドアクローザー露出型")
string_99 = StringInput("(建具)雑_フロアヒンジ")
string_100 = StringInput("【建具】雑_自閉式上吊り引戸装置")
string_101 = StringInput("(建具)雑_誘導灯開口")
list_create_23 = List.Create(item0=string_94, item1=string_95, item2=string_96, item3=string_97, item4=string_98, item5=string_99, item6=string_100, item7=string_101)

watch_3 = Watch(levels)

# group: 指定の階にある窓を取得する
# 説明<グループの説明を編集するにはここをダブル クリック>
categories_3 = Categories("OST_Windows")
all_elements_of_category_3 = ElementsOfCategory(Category=categories_3)
code_block_25 = CodeBlock { "レベル"; }
getParameterValueByName_4 = Element.GetParameterValueByName(element=all_elements_of_category_3, parameterName=code_block_25)
equals_5 = List.Equals(object=getParameterValueByName_4@L1, otherObject=watch_3)

# group: 作業面が指定のレベルにあるものも抽出する
# 説明<グループの説明を編集するにはここをダブル クリック>
code_block_26 = CodeBlock { "作業面"; }
getParameterValueByName_5 = Element.GetParameterValueByName(element=all_elements_of_category_3, parameterName=code_block_26)
name_2 = Level.Name(level=watch_3)
contains = String.Contains(string=getParameterValueByName_5, searchFor=name_2)

# group: ファミリ内ファミリかどうかを判定する。
# 説明<グループの説明を編集するにはここをダブル クリック>
python_script_16 = Python(IN[0]=all_elements_of_category_3)  # CPython3; same code as python_script_2
code_block_27 = CodeBlock(X=python_script_16) { X[0]; }
not_5 = Not(x=code_block_27)

# group: タイトル<グループのタイトルを編集するにはここをダブル クリック>
# 説明<グループの説明を編集するにはここをダブル クリック>
or_ = Or(bool0=equals_5, bool1=contains)
and_2 = And(bool0=or_, bool1=not_5)
filterByBoolMask_5 = List.FilterByBoolMask(list=all_elements_of_category_3, mask=and_2)

# group: 近接中心性、次数中心性、取付場所変数に初期値を入力完了までのダム
# 説明<グループの説明を編集するにはここをダブル クリック>
code_block_28 = CodeBlock { null; }
if_4 = RefactoredIf(test=eq, true=filterByBoolMask_5.in, false=code_block_28)

# group: 建具表除外の窓を除外する
# 説明<グループの説明を編集するにはここをダブル クリック>
getParameterValueByName_6 = Element.GetParameterValueByName(element=if_4, parameterName=string)
code_block_29 = CodeBlock { 1; }
equals_6 = List.Equals(object=getParameterValueByName_6@L1, otherObject=code_block_29)
not_6 = Not(x=equals_6)
filterByBoolMask_6 = List.FilterByBoolMask(list=if_4, mask=not_6)

# group: 窓用
list_create_24 = List.Create(item0=string_3, item1=string_5, item2=string_6, item3=string_7, item4=string_8, item5=string_9)

# group: 窓用
list_create_25 = List.Create(item0=string_11, item1=string_12, item2=string_13, item3=string_14, item4=string_15, item5=string_16)

# group: 窓用
list_create_26 = List.Create(item0=string_17, item1=string_18, item2=string_20)

# group: 窓用
list_create_27 = List.Create(item0=string_26)

# group: 窓用
list_create_28 = List.Create(item0=string_29)

# group: 窓用
list_create_29 = List.Create(item0=string_41)

# group: 膳板系
string_102 = StringInput("(建具)膳板_材質")
string_103 = StringInput("(建具)膳板_仕上")
string_104 = StringInput("(建具)膳板_寸法")

# group: 窓用
list_create_30 = List.Create(item0=string_102, item1=string_103, item2=string_104)

# group: 額縁系
string_105 = StringInput("(建具)額縁_材質")
string_106 = StringInput("(建具)額縁_仕上")
string_107 = StringInput("(建具)額縁_寸法")

# group: 窓用
list_create_31 = List.Create(item0=string_105, item1=string_106, item2=string_107)

# group: 水切板系
string_108 = StringInput("(建具)水切板_材質")
string_109 = StringInput("(建具)水切板_仕上")
string_110 = StringInput("(建具)水切板_寸法")

# group: 窓用
list_create_32 = List.Create(item0=string_108, item1=string_109, item2=string_110)

# group: 窓に使われているパラメーター
list_create_33 = List.Create(item0=list_create_24, item1=list_create_25, item2=list_create_26, item3=list_create_27, item4=list_create_28, item5=list_create_29, item6=list_create_30, item7=list_create_31, item8=list_create_32)

flatten_2 = List.Flatten(list=list_create_33)

# group: 入力されたパラメーターのリストごとに分類する
# パラメーター名がないものは自動的に無視してちゃんと機能する。
python_script_17 = Python(IN[0]=filterByBoolMask_6.in, IN[1]=flatten_2)  # CPython3; same code as python_script_11
code_block_30 = CodeBlock(x=python_script_17) { x[0]; }

# group: グループ内に複数個あるものを抽出する
# 説明<グループの説明を編集するにはここをダブル クリック>
count_6 = List.Count(list=code_block_30@L2)
code_block_31 = CodeBlock { 1; }
eq_3 = count_6 == code_block_31
not_7 = Not(x=eq_3)
filterByBoolMask_7 = List.FilterByBoolMask(list=code_block_30, mask=not_7)

# group: 集計表の取付場所と同じ計算結果(部屋名)を出力する。
# 集計表の計算値を取得する方法が見当たらないため。
# 計算値は共有パラでも、組み込みパラでも、プロジェクトパラでもないため。
# ※集計表の計算式を変えた場合はこの式も変えなければならない。
python_script_18 = Python(IN[0]=filterByBoolMask_7.in, IN[1]=近接中心性のパラメーター名, IN[2]=次数中心性のパラメーター名, IN[3]=建具の取付場所_変数のパラメーター名)  # CPython3; same code as python_script_12

# group: APIに入力するテンプレートにする
# 説明<グループの説明を編集するにはここをダブル クリック>
python_script_19 = Python(IN[0]=filterByBoolMask_7.in, IN[1]=python_script_18)  # CPython3; same code as python_script_13

# group: 生成AIで部屋名をまとめる。
# 説明<グループの説明を編集するにはここをダブル クリック>
python_script_20 = Python(IN[0]=openai_apiキー, IN[1]=python_script_10, IN[2]=python_script_19)  # CPython3; same code as python_script_14

# group: 生成された辞書リストを分解する。
code_block_32 = CodeBlock { "ID"; }
valueAtKey_3 = DesignScript.Builtin.Dictionary.ValueAtKey(dictionary=python_script_20, key=code_block_32)
element_by_id_2 = ElementById(Id=valueAtKey_3)
code_block_33 = CodeBlock { "名前"; }
valueAtKey_4 = DesignScript.Builtin.Dictionary.ValueAtKey(dictionary=python_script_20, key=code_block_33)

# group: 生成後と生成前の名前が変わらないものを除外する。 > 集計表の取付場所と同じ計算結果(部屋名)を出力する。
# 説明<グループの説明を編集するにはここをダブル クリック>
python_script_21 = Python(IN[0]=element_by_id_2, IN[1]=近接中心性のパラメーター名, IN[2]=次数中心性のパラメーター名, IN[3]=建具の取付場所_変数のパラメーター名)  # CPython3; same code as python_script_12

# group: 生成後と生成前の名前が変わらないものを除外する。
# 説明<グループの説明を編集するにはここをダブル クリック>
equals_7 = List.Equals()  # unwired: object, otherObject
combine_2 = List.Combine(combineFunction=equals_7, list0=python_script_21, list1=valueAtKey_4)
not_8 = Not(x=combine_2)
function_node_2 = List.FilterByBoolMask(list=element_by_id_2, mask=not_8)
除外された名前_2 = List.FilterByBoolMask(list=valueAtKey_4, mask=not_8)

# group: 生成結果が違うものに対して 取付場所をまとまった名前を入力して、取付場所変数に1を入力する。
setParameterByName_8 = Element.SetParameterByName(element=function_node_2.in, parameterName=string_2, value=除外された名前_2.in)
code_block_34 = CodeBlock { 1; }
setParameterByName_9 = Element.SetParameterByName(element=function_node_2.in, parameterName=建具の取付場所_変数のパラメーター名, value=code_block_34)

# group: 取付場所変数に0を入力。 もしくは値のある方の変数（2or3）を入力する。
# 説明<グループの説明を編集するにはここをダブル クリック>
# note: 取付場所変数:0　→　近接中心性が低い方。もしくは次数中心性が低い方
# 取付場所変数:1　→　取付場所(入力用)
# 取付場所変数:2　→　部屋から:名称
# 取付場所変数:3　→　部屋へ:名称;
python_script_22 = Python(IN[0]=filterByBoolMask_5.in, IN[1]=建具の取付場所_変数のパラメーター名)  # CPython3; same code as python_script_9
watch_4 = Watch(python_script_22)
